# Grasshopper definition LLM_talk_grasshopper.gh (Grasshopper 1.0.8)

panel = Panel("sql/building_panels-database1.db\"")
panel_2 = Panel("for a resdential building in new york what is the recommended fenestration opening ratio?")
py3 = Python3Script(input_text=panel_2, run=Toggle(True))  # -> out, a
# ---------- py3: Python ----------
#r: requests
import requests
import re

url = 'http://localhost:6000/llm_call'
payload = {'input': input_text}


out = None
if run:
    response = requests.post(url, json=payload)

    if response.status_code == 200:
        data = response.json()
        out = data['response']
    else:
        out = "Failed to connect:"

a = out
# ---------- end py3 ----------
panel_3 = Panel(py3.a)
